% Simulink data dictionary objDict.sldd

Control_st = Simulink.Bus()  % Структура с сигналами управления преобразователем
  PWM_ref: single
  Ena: uint16
  OPTO_1: uint16
  OPTO_2: uint16
  OPTO_3: uint16

Vout_ref = Simulink.Signal(StorageClass="Struct", StructName="SystemSignals", DataType="single")
Iref_lim = Simulink.Signal(StorageClass="Struct", StructName="SystemSignals", DataType="single")
Iref = Simulink.Signal(StorageClass="Struct", StructName="SystemSignals", DataType="single")
V_pwm = Simulink.Signal(StorageClass="Struct", StructName="SystemSignals", DataType="single")
PWM_ref = Simulink.Signal(StorageClass="Struct", StructName="SystemSignals", DataType="single")

FeedBack_st = Simulink.Bus()  % Структура с сигналами обратных связей
  Vin2: single
  Vin: single
  Iin: single
  Iout: single
  Vout: single
  Temp: single
  EnableSignal: uint16  % Внешний сигнал разрешения работы преобразователя